# Grasshopper definition annual_daylight.gh (Grasshopper 1.0.7)

# ---- group: Opaque Faces
geo = Geometry([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])
roomsolid = HBRoomFromSolid(geo=flatten(geo), name="TestRoom", conditioned=True)  # -> report, rooms; plug-in component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

# ---- group: Apertures
# Geometry Preparation
panel = Panel("g_material")
glassmod = HBGlassModifier(name=panel, trans="0.55")  # -> modifier; plug-in component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
brep = Brep([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])
aperture = HBAperture(geo=brep, rad_mod=glassmod)  # -> report, apertures; plug-in component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
addsubface = HBAddSubface(hb_obj=flatten(roomsolid.rooms), sub_faces=flatten(aperture.apertures))  # -> hb_obj; plug-in component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
bordershades = HBExtrudedBorderShades(hb_objs=flatten(addsubface), depth="0.3")  # -> report, hb_objs; plug-in component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

# ---- group: Context!
brep_2 = Brep([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])
shade = HBShade(geo=brep_2)  # -> report, shades; plug-in component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

# ----
# Model + Grids
panel_2 = Panel("sample_model_grid")
model = HBModel(rooms=flatten(bordershades.hb_objs), shades=flatten(shade.shades), name=panel_2)  # -> report, model; plug-in component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
gridrooms = HBSensorGridFromRooms(rooms=bordershades.hb_objs, grid_size="1")  # -> grid, points, mesh; plug-in component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
assigngridsviews = HBAssignGridsAndViews(model=model.model, grids=flatten(gridrooms.grid))  # -> model; plug-in component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
vizwiref = HBVizualizeWireframe(hb_objs=flatten(model.model))  # -> geo; plug-in component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

# ----
# Wea
panel_3 = Panel("https://www.energyplus.net/weather-download/north_and_central_america_wmo_region_4/USA/MA/USA_MA_Boston-Logan.Intl.AP.725090_TMY3/all")
downloadepw = LBDownloadWeather(weather_URL=panel_3)  # -> epw_file, stat_file, ddy_file; plug-in component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
wea = HBWeaFromEPW(epw_file=downloadepw.epw_file)  # -> wea; plug-in component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

# ----
# Run Recipe
panel_4 = Panel("3")
recipesettings = HBRecipeSettings(workers=panel_4, reload_old=False)  # -> settings; plug-in component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
annualdaylight = HBAnnualDaylight(
    model=assigngridsviews,
    wea=wea,
    thresholds="-t 500",
    schedule="Generic Office Occupancy",
    sensor_count="30",
    run_settings=recipesettings,
    run=Toggle(True))  # -> report, results, DA, cDA, UDI, UDI_low, UDI_up; plug-in component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

lightingcontrol = Honeybee_LightingControlRecipe(results=1, setpoint=250)  # -> schedule; plug-in component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

# ----
# Compute sDA
sda = HBSpatialDaylightAutonomy(DA=annualdaylight.DA, target_DA=50)  # -> report, sDA, pass_fail; plug-in component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

# ----
# Visualize Daylight Autonomy
mjoin = MeshJoin(Meshes=gridrooms.mesh)
data = Data(flatten(annualdaylight.DA))
heatmap = LBSpatialHeatmap(values=data, mesh=mjoin, legend_title="%")  # -> mesh, legend, title, colors, legend_par; plug-in component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

# ----
# Visualize Hourly
# Illuminance for
# a Sensor
number_slider = Slider(45, range=0..100)
pt = Point(gridrooms.points)
data_2 = Data(annualdaylight.results)
bang = ExplodeTree(Data=pt)  # -> Branch0, Branch1
item = ListItem(List=bang.Branch0, Index=number_slider, Wrap=True)
sph = Sphere(Base=item, Radius="0.5")
annualtodata = HBAnnualResultsToData(results=data_2, sel_pts=item, all_pts=pt)  # -> report, data; plug-in component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
hourlyplot = LBHourlyPlot(data=annualtodata.data, base_pt="50,0,0")  # -> report, mesh, legend, borders, labels, title; plug-in component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
