# Grasshopper definition breeam_4b.gh (Grasshopper 1.0.7)

# ----
# Programs
# The rooms must be assigned a valid program type. You can
# find the valid program type names here:
# https://github.com/pollination/breeam-daylight-4b/blob/master/README.md
# 
# You can also download a file with the valid programs, and then use
# HB Search Programs. See the link above for the file.
panel = Panel("BREEAM::Office_buildings::Occupied_spaces")
programtype = HBProgramType(name=[panel, "BREEAM::Education_buildings::Higher_education"])  # -> program; plug-in component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

# ----
# The search results will be empty
# unless you downloaded the file
# with program types.
searchprog = HBSearchPrograms(keywords="breeam")  # -> room_prog; plug-in component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
panel_2 = Panel(searchprog)

# ---- group: Opaque Faces
geo = Geometry([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])
roomsolid = HBRoomFromSolid(geo=flatten(geo), name="TestRoom", program=programtype, conditioned=True)  # -> report, rooms; plug-in component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

# ---- group: Apertures
# Geometry Preparation
panel_3 = Panel("g_material")
glassmod = HBGlassModifier(name=panel_3, trans="0.55")  # -> modifier; plug-in component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
brep = Brep([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])
aperture = HBAperture(geo=brep, rad_mod=glassmod)  # -> report, apertures; plug-in component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
addsubface = HBAddSubface(hb_obj=flatten(roomsolid.rooms), sub_faces=flatten(aperture.apertures))  # -> report, hb_obj, unmatched; plug-in component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
bordershades = HBExtrudedBorderShades(hb_objs=flatten(addsubface.hb_obj), depth="0.3")  # -> report, hb_objs; plug-in component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

# ---- group: Context!
brep_2 = Brep([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])
shade = HBShade(geo=brep_2)  # -> report, shades; plug-in component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

# ----
# Model + Grids
panel_4 = Panel("sample_model_grid")
model = HBModel(rooms=flatten(bordershades.hb_objs), shades=flatten(shade.shades), name=panel_4)  # -> report, model; plug-in component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
gridrooms = HBSensorGridFromRooms(rooms=bordershades.hb_objs, grid_size="0.5")  # -> grid, points, mesh; plug-in component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
assigngridsviews = HBAssignGridsAndViews(model=model.model, grids=flatten(gridrooms.grid))  # -> model; plug-in component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
vizwiref = HBVisualizeWireframe(hb_objs=flatten(model.model))  # -> geo; plug-in component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

# ----
# Wea
panel_5 = Panel("https://energyplus-weather.s3.amazonaws.com/north_and_central_america_wmo_region_4/USA/MA/USA_MA_Boston-Logan.Intl.AP.725090_TMY3/USA_MA_Boston-Logan.Intl.AP.725090_TMY3.zip")
downloadepw = LBDownloadWeather(weather_URL=panel_5)  # -> epw_file, stat_file, ddy_file; plug-in component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
wea = HBWeaFromEPW(epw_file=downloadepw.epw_file)  # -> wea; plug-in component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

# ----
# Run Recipe
toggle = BooleanToggle(False)
breeam4b = HBBREEAMDaylight4b(model=assigngridsviews, wea=wea, run=toggle)  # -> report, results, summary, program_summary; plug-in component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

panel_6 = Panel(breeam4b.program_summary)
panel_7 = Panel(breeam4b.summary)
daylightmetrics = HBAnnualDaylightMetrics(results=flatten(breeam4b.results))  # -> report, DA, cDA, UDI, UDI_low, UDI_up; plug-in component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

# ----
# Compute sDA
sda = HBSpatialDaylightAutonomy(DA=daylightmetrics.DA, mesh=gridrooms.mesh)  # -> report, sDA, pass_fail; plug-in component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
sda_in_each_room = Panel(sda.sDA)

# ----
# Visualize Daylight Autonomy
mjoin = MeshJoin(Meshes=gridrooms.mesh)
data = Data(flatten(daylightmetrics.DA))
heatmap = LBSpatialHeatmap(values=data, mesh=mjoin, legend_title="%")  # -> mesh, legend, title, colors, legend_par, vis_set; plug-in component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
