# Grasshopper definition creating_skies.gh (Grasshopper 1.0.7)
# plug-ins: Ironbug.LBHB_Legacy

txt = Text("http://climate.onebuilding.org/WMO_Region_4_North_and_Central_America/USA_United_States_of_America/IL_Illinois/USA_IL_Chicago.OHare.Intl.AP.725300_TMY3.zip")
downloadepw = LBDownloadWeather(weather_URL=txt)  # -> epw_file, stat_file, ddy_file; plug-in component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

importloc = LBImportLocation(epw_file=downloadepw.epw_file)  # -> location; plug-in component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

# ----
# Annual Weather Objects (.wea)
importepw = LBImportEPW(epw_file=downloadepw.epw_file)  # -> location, dry_bulb_temperature, dew_point_temperature, relative_humidity, wind_speed, wind_direction, direct_normal_rad, diffuse_horizontal_rad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; plug-in component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
zhang_huang = HBWeaFromZhangHuang(
    location=importepw.location,
    cloud_cover=importepw.total_sky_cover,
    rel_humidity=importepw.relative_humidity,
    dry_bulb_temp=importepw.dry_bulb_temperature,
    wind_speed=importepw.wind_speed,
    atmos_pressure=importepw.barometric_pressure)  # -> wea; plug-in component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
clearsky = HBWeaFromClearSky(location=importloc)  # -> wea; plug-in component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
wea = HBWeaFromEPW(epw_file=downloadepw.epw_file)  # -> wea; plug-in component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
tauclearsky = HBWeaFromTauClearSky(stat_file=downloadepw.stat_file, timestep="1")  # -> wea; plug-in component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

# ----
# Point-In-Time
# Sky Objects (.sky)
panel = Panel("100")
ciesky = HBCIEStandardSky(location=importloc, month="3", day="3", hour="12", type=0)  # -> sky; plug-in component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
climatebased = HBClimatebasedSky(wea=clearsky, month="9", hour="9")  # -> sky; plug-in component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
certainillum = HBCertainIlluminance()  # -> sky; plug-in component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
customsky = HBCustomSky(location=importloc, dir_rad="800", diff_rad=panel, month=6, day=21, hour=12)  # -> sky; plug-in component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

# ----
# Visualize Wea
decnstrwea = HBDeconstructWea(wea=wea)  # -> dir, diff, glob; plug-in component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
hourlyplot = LBHourlyPlot(data=[decnstrwea.dir, decnstrwea.diff, decnstrwea.glob])  # -> report, mesh, legend, borders, labels, title; plug-in component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

# ----
# Visualize the Sky
vizsky = HBVisualizeSky(sky=climatebased)  # -> hdr, ghi; plug-in component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
falsecolor = HBFalseColor(hdr=vizsky.hdr, legend_height="400")  # -> hdr; plug-in component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
hdr_gif = HBHDRToGIF(hdr=vizsky.hdr)  # -> gif; plug-in component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
imageviewer = Ladybug_ImageViewer(ImagePath_=falsecolor, _scale_=1, DisableClickable=False, SaveImgWithCoords=False, scale=1)  # -> ImagePath, Values, GIF
