# Grasshopper definition cumulative_radiation.gh (Grasshopper 1.0.7)

# ----
# Geometry Preparation
geo = Geometry([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])
roomsolid = HBRoomFromSolid(geo=flatten(geo), conditioned=True)  # -> report, rooms; plug-in component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
brep = Brep([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])
aperture = HBAperture(geo=brep)  # -> report, apertures; plug-in component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
addsubface = HBAddSubface(hb_obj=flatten(roomsolid.rooms), sub_faces=flatten(aperture.apertures))  # -> report, hb_obj, unmatched; plug-in component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
bordershades = HBExtrudedBorderShades(hb_objs=flatten(addsubface.hb_obj), depth="0.3")  # -> report, hb_objs; plug-in component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

brep_2 = Brep([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])
shade = HBShade(geo=brep_2)  # -> report, shades; plug-in component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

# ----
# Sensor Grid Preperation
panel = Panel("2500")
settings_custom = SettingsCustom(
    StitchSeams=True,
    SimplePlanes=False,
    Refine=True,
    MinCount=panel,
    MaxCount=400,
    AspectRatio=20,
    MaxDistance=0,
    MaxAngle=20,
    MinEdge=0,
    MaxEdge=0)
geometry = Geometry(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)
mesh_brep = MeshBrep(Brep=geometry, Settings=settings_custom)
face_normals = FaceNormals(Mesh=mesh_brep)  # -> Centers, Normals
sensorgrid = HBSensorGrid(name="Ground", positions=face_normals.Centers)  # -> grid; plug-in component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

# ----
# Model
panel_2 = Panel("hb_cumulative_rad")
model = HBModel(rooms=flatten(bordershades.hb_objs), shades=flatten(shade.shades), name=panel_2)  # -> report, model; plug-in component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
assigngridsviews = HBAssignGridsAndViews(model=model.model, grids=flatten(sensorgrid))  # -> model; plug-in component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
vizwiref = HBVisualizeWireframe(hb_objs=flatten(model.model))  # -> geo; plug-in component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

# ----
# Weather Preperation
panel_3 = Panel("https://energyplus-weather.s3.amazonaws.com/north_and_central_america_wmo_region_4/USA/FL/USA_FL_Jacksonville.NAS.722065_TMY3/USA_FL_Jacksonville.NAS.722065_TMY3.zip")
downloadepw = LBDownloadWeather(weather_URL=panel_3)  # -> epw_file, stat_file, ddy_file; plug-in component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
wea = HBWeaFromEPW(epw_file=downloadepw.epw_file)  # -> wea; plug-in component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

# ----
# Run The Recipe
run_me = BooleanToggle(False)
cumulativeradiation = HBCumulativeRadiation(model=assigngridsviews, wea=wea, run=run_me)  # -> out, avg_irr, radiation; plug-in component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

# ----
# Visualize Results
results_mesh_color = Slider(2, range=0..29)
colrange = LBColorRange(index=results_mesh_color)  # -> colors; plug-in component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
legendpar = LBLegendParameters(colors=colrange)  # -> leg_par; plug-in component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
heatmap = LBSpatialHeatmap(
    values=cumulativeradiation.radiation,
    mesh=mesh_brep,
    legend_par=legendpar,
    legend_title="Cumulative Radiation kWh/m2",
    global_title="Cumulative Radiation Sample")  # -> mesh, legend, title, colors, legend_par, vis_set; plug-in component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
