# Grasshopper definition point_in_time_gridbased.gh (Grasshopper 1.0.7)

# ---- group: Opaque Faces
geo = Geometry([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])
roomsolid = HBRoomFromSolid(geo=flatten(geo), conditioned=True)  # -> report, rooms; plug-in component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

# ---- group: Apertures
# Geometry Preparation
panel = Panel("g_material")
glassmod = HBGlassModifier(name=panel, trans="0.55")  # -> modifier; plug-in component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
brep = Brep([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])
aperture = HBAperture(geo=brep, rad_mod=glassmod)  # -> report, apertures; plug-in component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
addsubface = HBAddSubface(hb_obj=roomsolid.rooms, sub_faces=flatten(aperture.apertures))  # -> hb_obj; plug-in component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
bordershades = HBExtrudedBorderShades(hb_objs=flatten(addsubface), depth="0.3")  # -> report, hb_objs; plug-in component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

# ----
# Analysis Grid
# Generate test points
# You can use any other grasshopper
# components to generate these points.
brep_2 = Brep([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])
genpts = LBGeneratePointGrid(geometry=brep_2, grid_size="1", dist_surface=Slider(0.762, range=0..1))  # -> points, vectors, face_areas, mesh; plug-in component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
panel_2 = Panel("""room_a
room_b""")
graft = GraftTree(Tree=panel_2, IncludeEmptyLists=True, IncludeNullItems=True)
gridrooms = HBSensorGridFromRooms(rooms=bordershades.hb_objs, grid_size="1")  # -> grid, points, mesh; plug-in component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
sensorgrid = HBSensorGrid(name=graft, positions=genpts.points)  # -> grid; plug-in component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

# ---- group: Context!
brep_3 = Brep([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])
shade = HBShade(geo=brep_3)  # -> report, shades; plug-in component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

# ----
# Point in time daylight simulation aka Grid-based
# This is the same as grid-based daylight simulation in honeybee-legacy
# Sky
# Use any of the sky components to
# generate the sky for the simulation.
txt = Text("https://www.energyplus.net/weather-download/north_and_central_america_wmo_region_4/USA/IL/USA_IL_Chicago-OHare.725300_TMY2/all")
downloadepw = LBDownloadWeather(weather_URL=txt)  # -> epw_file, stat_file, ddy_file; plug-in component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
path = FilePath(downloadepw.epw_file)
wea = HBWeaFromEPW(epw_file=path)  # -> wea; plug-in component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
importloc = LBImportLocation(epw_file=path)  # -> location; plug-in component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
climatebased = HBClimatebasedSky(wea=wea, month="9", hour="9")  # -> sky; plug-in component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
ciesky = HBCIEStandardSky(location=importloc, month=6, day=21, type=0)  # -> sky; plug-in component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

data = Data(climatebased)
# Model
model = HBModel(rooms=flatten(bordershades.hb_objs), shades=flatten(shade.shades), name="hb_sample_model_grid")  # -> report, model; plug-in component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
# Recipe
gridbasedrecipe = HBGridBasedRecipe(sky=data, grids=flatten(sensorgrid))  # -> recipe; plug-in component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

# ----
# Visualize Model
faceradianceattr = HBFaceEnergyAttributes({"Modifier": "properties.radiance.modifier.display_name", "Modifier Blk": "properties.radiance.modifier_blk.display_name", "Is Opaque": "properties.radiance.is_opaque", "Dynamic Group": "properties.radiance.dynamic_group_identifier", "State Count": "properties.radiance.state_count", "States": "properties.radiance.states"}, selected="Modifier")
roomradianceattr = HBRoomEnergyAttributes({"Modifier Set": "properties.radiance.modifier_set.display_name"}, selected="Modifier Set")
colorfaceattr = HBColorFaceAttributes(hb_objs=flatten(model.model), attribute=faceradianceattr)  # -> mesh, legend, wire_frame, values; plug-in component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
colorroomattr = HBColorRoomAttributes(attribute=roomradianceattr)  # -> mesh, legend, wire_frame, values; plug-in component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

# ----
# Run the simulation
# Set write to True to save the files to
# the project folder. This gives you the
# option to check the files before running
# the simulation.
# 
# Once ready also set run to True and the
# component will run the study. The output
# will be the analysis grids or an image
# collection based on the analysis type.
runradiance = HBRunRadiance(recipe=gridbasedrecipe, model=model.model, write=Toggle(False))  # -> report, folder, outputs; plug-in component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
